# Grasshopper definition Brep.ghx (Grasshopper 1.0.7)
# plug-ins: Human, EleFront

panel = Panel("""Retail
Retail
Retail
Comm
Resi
Resi 
etc""")
panel_2 = Panel("Main")
panel_3 = Panel("Podium")
f2f = Panel("3.1")
levels = Panel("5")
f2f_2 = Panel("3.1")
levels_2 = Panel("10")
f2f_3 = Panel("4")
levels_3 = Panel("20")
dpipeline = DynamicGeometryPipeline(
    LayerFilter="Horizontal",
    TypeFilter="Curve",
    NameFilter="*",
    GroupByLayer=False,
    GroupByType=False,
    IncludeHidden=True,
    IncludeLocked=True,
    enableFullPath=True,
    listenToAttributes=True)
dpipeline_2 = DynamicGeometryPipeline(
    LayerFilter="Vertical 2",
    TypeFilter="Curve",
    NameFilter="*",
    GroupByLayer=False,
    GroupByType=False,
    IncludeHidden=True,
    IncludeLocked=True,
    enableFullPath=True,
    listenToAttributes=True)
loft = Loft(Curves=dpipeline_2, Options={Adjust=False, Closed=False, LoftEnds=0, LoftSimp=0, LoftType=0, Rebuild=10, Refit=0.01})
panel_4 = Panel("""BuildID
Typology
Levels
F2F
Parent
Efficiency""")
dpipeline_3 = DynamicGeometryPipeline(
    LayerFilter="Brep1",
    TypeFilter="Brep",
    NameFilter="*",
    GroupByLayer=False,
    GroupByType=False,
    IncludeHidden=True,
    IncludeLocked=True,
    enableFullPath=True,
    listenToAttributes=True)
panel_5 = Panel("""BuildID
Typology
Levels
F2F
Parent
Efficiency""")
panel_6 = Panel("""BuildID
Typology
Levels
F2F
Parent
Efficiency""")
dup = DuplicateData(Data="Retail", Number=levels, Order=True)  # -> simplify(Data)
series = Series(Start=Slider(0, range=0..100), Step=f2f, Count=levels)  # -> simplify(Series)
bbox = BoundingBox(Content=dpipeline_2, Plane=PlaneXY(0, 0, 0), UnionBox=True)  # -> Box, Box_2
item = ListItem(List=series, Index=-1, Wrap=True)
debrep = DeconstructBrep(Brep=bbox.Box)  # -> Faces, Edges, Vertices
eval = EvaluateCurve(Curve=reparameterize(dpipeline), Parameter=0)  # -> Point, Tangent, Angle
series_2 = Series(Start=item, Step=f2f_2, Count=levels_2)  # -> simplify(Series)
dup_2 = DuplicateData(Data="Comm", Number=levels_3, Order=True)  # -> simplify(Data)
item_2 = ListItem(List=series_2, Index=-1, Wrap=True)
dup_3 = DuplicateData(Data="Resi", Number=levels_2, Order=True)  # -> simplify(Data)
series_3 = Series(Start=item_2, Step=f2f_3, Count=levels_3)  # -> simplify(Series)
area = Area(Geometry=debrep.Faces)  # -> Area, Centroid
brep = Brep([<brep referenced from the Rhino model> x3])
area_2 = Area(Geometry=bbox.Box)  # -> Area, Centroid
pdecon = Deconstruct(Point=eval.Point)  # -> XComponent, YComponent, ZComponent
pdecon_2 = Deconstruct(Point=area.Centroid)  # -> XComponent, YComponent, ZComponent
rl = Panel(series)
rl_2 = Panel(series_3)
rl_3 = Panel(series_2)
panel_7 = Panel(debrep.Faces)
f2f_4 = Panel(dup)
sort = SortList(Keys=pdecon.ZComponent, ValuesA=dpipeline)  # -> Keys, ValuesA
attributes = DefineObjectAttributes(UserKeys=panel_5, UserValues=panel_4, Layer="Brep3")
sort_2 = SortList(Keys=pdecon_2.ZComponent, ValuesA=debrep.Faces)  # -> Keys, ValuesA
f2f_5 = Panel(dup_3)
f2f_6 = Panel(dup_2)
building_id = Data()
parent = Data()
efficiency = Data()
typology = Data()
storeys = Data()
f2f_7 = Data()
item_3 = ListItem(List=sort_2.ValuesA, Index=0, Wrap=True)
bake = BakeObjects(Geometry=brep, Attributes=attributes, Bake=False)
loft_2 = Loft(Curves=sort.ValuesA, Options={Adjust=False, Closed=False, LoftEnds=0, LoftSimp=0, LoftType=0, Rebuild=10, Refit=0.01})
eval_2 = EvaluateCurve(Curve=reparameterize(dpipeline_2), Parameter=0)  # -> Point, Tangent, Angle
debrep_2 = DeconstructBrep(Brep=item_3)  # -> Faces, Edges, Vertices
merge = Merge()
cap = CapHoles(Brep=loft_2)
join = JoinCurves(Curves=debrep_2.Faces, Preserve=False)
alongcrv = SortAlongCurve(Points=eval_2.Point, Curve=join)  # -> Points, Indices
item_4 = ListItem(List=dpipeline_2, Index=alongcrv.Indices, Wrap=True)
shift = ShiftList(List=item_4, Shift=Slider(1, range=0..1), Wrap=True)
graft = GraftTree(Tree=shift, IncludeEmptyLists=True, IncludeNullItems=True)
graft_2 = GraftTree(Tree=item_4, IncludeEmptyLists=True, IncludeNullItems=True)
item_5 = ListItem(List=graft_2, Index=0, Wrap=True)  # -> simplify(Item)
item_6 = ListItem(List=graft, Index=0, Wrap=True)  # -> simplify(Item)
merge_2 = Merge(Data1=item_5, Data2=item_6)
loft_3 = Loft(Curves=merge_2, Options={Adjust=False, Closed=False, LoftEnds=0, LoftSimp=0, LoftType=0, Rebuild=10, Refit=0.01})
cap_2 = CapHoles()
panel_8 = Panel("""3@12=Comm
25@3.1=Resi
4@12=Comm
17@3.1=Resi""")
panel_9 = Panel("BuildID:1")
panel_10 = Panel("""4@4=Basement
3@12=Comm
5@3.1=Resi
10@12=Comm
12@3.1=Resi""")
join_2 = TextJoin(Text=panel_10, Join="*")
join_3 = TextJoin(Text=panel_8, Join="*")
data = Data(reverse(panel_10))
dpipeline_4 = DynamicGeometryPipeline(
    LayerFilter="Brep3",
    TypeFilter="Brep",
    NameFilter="*",
    GroupByLayer=False,
    GroupByType=False,
    IncludeHidden=True,
    IncludeLocked=True,
    enableFullPath=True,
    listenToAttributes=True)
merge_3 = Merge(Data1=join_2, Data2=join_3)
building_in_order = Panel(data)
getuv = GetUserValue(Geometry=dpipeline_4, Key="BuildID")
split = TextSplit(Text=merge_3, Separators="*")  # -> simplify(Result)
cset = CreateSet(List=getuv)  # -> simplify(graft(Set)), Map
panel_11 = Panel(split)
split_2 = TextSplit(Text=data, Separators="@")
tmatch = MatchText(Text=getuv, Pattern=cset.Set, Case=True)
split_3 = TextSplit(Text=split_2, Separators="=")  # -> graft(Result)
dispatch = Dispatch(List=dpipeline_4, DispatchPattern=tmatch)  # -> simplify(ListA), ListB
trim = TrimTree(Tree=split_3, Depth=1)
trim_2 = TrimTree(Tree=trim, Depth=1)
getuv_2 = GetUserValue(Geometry=dispatch.ListA, Key="F2F")
getuv_3 = GetUserValue(Geometry=dispatch.ListA, Key="Typology")
item_7 = ListItem(List=trim_2, Index=0, Wrap=True)  # -> Item, Item1, Item2
debrep_3 = DeconstructBrep(Brep=dispatch.ListA)  # -> Faces, Edges, simplify(Vertices)
tmatch_2 = MatchText(Text=item_7.Item2, Pattern="Basement", Case=True)  # -> simplify(Match)
bbox_2 = BoundingBox(Content=dispatch.ListA, Plane=PlaneXY(0, 0, 0))  # -> Box, Box_2
debox = DeconstructBox(Box=bbox_2.Box)  # -> Plane, X, Y, Z
pdecon_3 = Deconstruct(Point=debrep_3.Vertices)  # -> XComponent, YComponent, ZComponent
panel_12 = Panel(getuv_2)

# ---- group: typology names
dup_4 = DuplicateData(Data=item_7.Item2, Number=item_7.Item, Order=True)  # -> simplify(flatten(Data))

# ---- group: floor to floor
dup_5 = DuplicateData(Data=item_7.Item1, Number=item_7.Item, Order=True)  # -> simplify(Data)

# ---- group: split above and below ground
join_4 = TextJoin(Text=dup_5, Join="/")
dispatch_2 = Dispatch(List=join_4, DispatchPattern=tmatch_2)  # -> Basement, AboveGround

# ----
dedomain = DeconstructDomain(Domain=debox.Z)  # -> Start, End
sort_3 = SortList(Keys=pdecon_3.ZComponent, ValuesA=debrep_3.Vertices)  # -> reverse(Keys), reverse(ValuesA)
subtraction = Subtraction(A=dedomain.End, B=dedomain.Start)
dpipeline_5 = DynamicGeometryPipeline(
    LayerFilter="Brep4",
    TypeFilter="Brep",
    NameFilter="*",
    GroupByLayer=False,
    GroupByType=False,
    IncludeHidden=True,
    IncludeLocked=True,
    enableFullPath=True,
    listenToAttributes=True)
getuv_4 = GetUserValue(Geometry=dpipeline_5, Key="BuildID")
item_8 = ListItem(List=sort_3.Keys, Index=-1, Wrap=True)  # -> simplify(Item)
panel_13 = Panel(getuv_4)
split_4 = TextSplit(Text=dispatch_2.AboveGround, Separators="/")  # -> simplify(Result)
division = Division(A=subtraction, B=getuv_2)
trim_3 = TrimTree(Tree=item_8, Depth=1)
split_5 = TextSplit(Text=dispatch_2.Basement, Separators="/")  # -> simplify(Result)
clean = CleanTree(RemoveNulls=True, RemoveInvalid=True, RemoveEmpty=True, Tree=split_4)  # -> flatten(Tree)
neg = Negative(Value=split_5)
rev = ReverseList(List=clean)
panel_14 = Panel(trim_3)
lng = ListLength(List=flatten(dup_5))
clean_2 = CleanTree(RemoveNulls=True, RemoveInvalid=True, RemoveEmpty=True, Tree=neg)
round = Round(Number=division)  # -> simplify(Nearest), Floor, Ceiling
consec = ConsecutiveDomains(Numbers=rev, Additive=True)
roof = Data(lng)
series_4 = Series(Start=trim_3, Step=getuv_2, Count=round.Nearest)
consec_2 = ConsecutiveDomains(Numbers=clean_2, Additive=True)
dedomain_2 = DeconstructDomain(Domain=consec)  # -> flatten(Start), End
panel_15 = Panel(division)
dedomain_3 = DeconstructDomain(Domain=consec_2)  # -> flatten(Start), End
rev_2 = ReverseList(List=dedomain_3.Start)
f2f_8 = Panel(rev_2)

# ---- group: facade
debrep_4 = DeconstructBrep(Brep=dpipeline_5)  # -> Faces, Edges, Vertices
area_3 = Area(Geometry=debrep_4.Faces)  # -> Area, Centroid
panel_16 = Panel("""-1
0""")
sort_4 = SortList(Keys=area_3.Centroid, ValuesA=debrep_4.Faces)  # -> Keys, ValuesA
cull_i = CullIndex(List=sort_4.ValuesA, Indices=panel_16, Wrap=True)

# ----
pt = ConstructPoint(XCoordinate=0, YCoordinate=0, ZCoordinate=series_4)  # -> simplify(Point)
graft_3 = GraftTree(Tree=dispatch.ListA, IncludeEmptyLists=True, IncludeNullItems=True)
xy = XYPlane(Origin=pt)
merge_4 = Merge(Data1=rev_2, Data2="0", Data3=dedomain_2.Start)
pt_2 = ConstructPoint(XCoordinate=0, YCoordinate=0, ZCoordinate=merge_4)

# ---- group: floor plates
sec = BrepPlane(Brep=dpipeline_5, Plane=pt_2)  # -> flatten(Curves), Points
boundary = BoundarySurfaces(Edges=sec.Curves)

# ----
rl_4 = Panel(merge_4)
sec_2 = BrepPlane(Brep=graft_3, Plane=xy)  # -> Curves, Points

# ---- group: roof
item_9 = ListItem(List=boundary, Index=-1, Wrap=True)

# ----
boundary_2 = BoundarySurfaces(Edges=sec_2.Curves)
facade = Data(cull_i)
trim_4 = TrimTree(Tree=boundary_2, Depth=1)
panel_17 = Panel(lng)
floorplate = Data(boundary)
roof_2 = Data(item_9)

# ---- group: properties
typology_2 = Data(dup_4)
rl_5 = Data(merge_4)

# ----
trim_5 = TrimTree(Tree=trim_4, Depth=1)
panel_18 = Panel(trim_4)
