# Grasshopper definition Curve method.ghx (Grasshopper 1.0.7)
# plug-ins: Redback, Human, Bifocals

# This Script uses Curves with Rhino user attributes to create towers.
# TheSubBuildID of each curve determines its hierachy within each
# tower. For example, SubBuildID A sits below AA and AB. SubBuild
# AB sits below ABA which sits below ABB.
# TOWER BY CURVES [Z - HEIGHT]
# This Script uses Curves with Rhino user attributes to create towers.
# The curves z height determines its hierachy within each tower. For
# example, if curve A sits below curve B, then A will be created below B.
# If curve C sits below curve A, then curve C with be created below A.
panel = Panel("  ")
# TOWER BY CURVES [SUBBUILDID]
gallery = ImageGallery(CycleDelay=30, Randomize=False, UseLocalImages=True, UseRemoteImages=True)
# 1. Create building curves
# with the following use
# attributes in Rhino
gallery_2 = ImageGallery(CycleDelay=30, Randomize=False, UseLocalImages=True, UseRemoteImages=True)
panel_2 = Panel("""BuildID
Typology
SubBuildID
Levels
F2F""")
# 1. Create building curves
# with the following use
# attributes in Rhino
panel_3 = Panel("""TOWER 1
Comm
A
3
3""")
# 2. Place curves under the
# layer "Tower by Curves -
# SubBuildID", and in the
# sublayer "Input Curves"
panel_4 = Panel("*")
# 1. Alternatively you can
# create the attributes in
# GH and bake it to Rhino
toggle_to_bake = BooleanToggle(False)
dpipeline = DynamicGeometryPipeline(
    LayerFilter="Tower By Curves - Z Height::Input Curves",
    TypeFilter="Curve",
    NameFilter=panel_4,
    GroupByLayer=False,
    GroupByType=False,
    IncludeHidden=True,
    IncludeLocked=True,
    enableFullPath=True,
    listenToAttributes=True)
createatts = CreateAttributes(UserDataKeys=panel_2, UserDataValues=panel_3, enableFullPath=False)
crv = Curve(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)
tower_by_curves_z_height = TowerByCurvesZHeight(building_curves=dpipeline)  # -> roof_2, roof_properties_2, full_mass_2, full_mass_properties_2, sub_mass_2, sub_mass_properties_2, facade_3, facade_properties_2, floorplates_2, floorplate_properties_2
bake = BakeGeometry(Bake=toggle_to_bake, Geometry=crv, Attributes=createatts, DeleteOldBakes=False, PreserveTrees=False)
# 3 Flick through value list to
# extract different floorplate
# properties
list = ValueList({"RL", "Area", "Typology", "BuildID", "SubBuildID"}, selected="BuildID")
# CREATING SUB MASS
# EXTRACTING SUB MASS PROPERTIES
# CREATING FACADE
# EXTRACTING FACADE PROPERTIES
# CREATING FLOORPLATES
# EXTRACTING FLOORPLATE PROPERTIES
read = ReadJSON(Object=tower_by_curves_z_height.floorplate_properties_2, Key=list)
# 2. Place curves under the
# layer "Tower by Curves -
# SubBuildID", and in the
# sublayer "Input Curves"
panel_5 = Panel("*")
brep = Brep(tower_by_curves_z_height.floorplates_2)
panel_6 = Panel(read)
dpipeline_2 = DynamicGeometryPipeline(
    LayerFilter="Tower by Curves - SubBuildID::Input Curves",
    TypeFilter="Curve",
    NameFilter=panel_5,
    GroupByLayer=False,
    GroupByType=False,
    IncludeHidden=True,
    IncludeLocked=True,
    enableFullPath=True,
    listenToAttributes=True)
output = DataOutput(
    Roof=tower_by_curves_z_height.roof_2,
    Roof_Properties=tower_by_curves_z_height.roof_properties_2,
    Full_Mass=tower_by_curves_z_height.full_mass_2,
    Full_Mass_Properties=tower_by_curves_z_height.full_mass_properties_2,
    Sub_Mass=tower_by_curves_z_height.sub_mass_2,
    Sub_Mass_Properties=tower_by_curves_z_height.sub_mass_properties_2,
    Facade=tower_by_curves_z_height.facade_3,
    Facade_Properties=tower_by_curves_z_height.facade_properties_2,
    Floorplates=tower_by_curves_z_height.floorplates_2,
    Floorplate_Properties=tower_by_curves_z_height.floorplate_properties_2,
    Destination="C:\Users\c-nbungbrakearti\Documents\GitHub\Hackathon2018\Compiled Feaso Components\Massing Methods\Curve Method\Curve Method.ghdata")  # disabled

# ---- group: Cluster
tower_by_curves_subbuildid = TowerByCurves(geo=dpipeline_2)  # -> roof_2, roof_properties_2, full_mass_2, full_mass_properties_2, sub_mass_2, sub_mass_properties_2, facade_3, facade_properties_2, floorplates_2, floorplate_properties_2

# ----
# 3 Flick through value list to
# extract different floorplate
# properties
list_2 = ValueList({"RL", "Area", "Typology", "BuildID", "SubBuildID"}, selected="Area")
output_2 = DataOutput(
    Roof=tower_by_curves_subbuildid.roof_2,
    Roof_Properties=tower_by_curves_subbuildid.roof_properties_2,
    Full_Mass=tower_by_curves_subbuildid.full_mass_2,
    Full_Mass_Properties=tower_by_curves_subbuildid.full_mass_properties_2,
    Sub_Mass=tower_by_curves_subbuildid.sub_mass_2,
    Sub_Mass_Properties=tower_by_curves_subbuildid.sub_mass_properties_2,
    Facade=tower_by_curves_subbuildid.facade_3,
    Facade_Properties=tower_by_curves_subbuildid.facade_properties_2,
    Floorplates=tower_by_curves_subbuildid.floorplates_2,
    Floorplate_Properties=tower_by_curves_subbuildid.floorplate_properties_2,
    Destination="C:\Users\c-nbungbrakearti\Documents\GitHub\Hackathon2018\Compiled Feaso Components\Massing Methods\Curve Method\Curve Method.ghdata")  # disabled
read_2 = ReadJSON(Object=tower_by_curves_subbuildid.floorplate_properties_2, Key=list_2)
brep_2 = Brep(tower_by_curves_subbuildid.floorplates_2)
panel_7 = Panel(read_2)

# ==== cluster TowerByCurves
geo = ClusterInput()
geo_2 = Geometry(geo)
panel = Panel(geo_2)
clockcrv = ClockwiseCurve(crv=geo_2)
data = Data(geo_2)
panel_2 = Panel(clockcrv)
objatts = ObjectAttributes(ObjectOrAttributes=data)  # -> Name, LayerName, LayerFullPath, Color, MaterialName, LinetypeName, GroupIndices, PlotWeight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
panel_3 = Panel("""BuildID
Typology
F2F
Levels
SubBuildID""")
json = JSON(Key=objatts.UserDataKeys, Value=objatts.UserDataValues)
read = ReadJSON(Object=json, Key=panel_3)
flip = FlipMatrix(Data=read)
read_2 = ReadJSON(Object=json, Key="Typology")  # -> flatten(Value)
read_3 = ReadJSON(Object=json, Key="SubBuildID")  # -> flatten(Value)
read_4 = ReadJSON(Object=json, Key="BuildID")  # -> flatten(Value)
branch = TreeBranch(Tree=simplify(flip), Path="3", MaintainPaths=True)  # -> graft(Branch)
branch_2 = TreeBranch(Tree=simplify(flip), Path="2", MaintainPaths=True)  # -> graft(Branch)
branch_3 = TreeBranch(Tree=flip, Path="0", MaintainPaths=True)
branch_4 = TreeBranch(Tree=flip, Path="4", MaintainPaths=True)
cset = CreateSet(List=flatten(read_4))  # -> Set, Map
addition = Addition(A=branch, B=1)
concat = Concatenate(FragmentA=branch_3, FragmentB=branch_4)
series = Series(Start=0, Step=branch_2, Count=addition)  # -> simplify(Series)
mindex = MemberIndex(Set=flatten(read_4), Member=cset.Set)  # -> Index, Count
panel_4 = Panel(concat)
python = GhPythonScript(ID=concat)  # -> StackID
# ---------- python: Python ----------
__author__ = "B-MBuckley"
__version__ = "2018.10.25"

import rhinoscriptsyntax as rs

StackID = []

for i in range(len(ID)-1):
    StackID.append(ID[0:i+1])
# ---------- end python ----------
item = ListItem(List=series, Index=0, Wrap=True)  # -> flatten(Item1), Item
item_2 = ListItem(List=read_2, Index=mindex.Index, Wrap=True)  # -> simplify(Item)
item_3 = ListItem(List=read_3, Index=mindex.Index, Wrap=True)
item_4 = ListItem(List=read_4, Index=mindex.Index, Wrap=True)
mindex_2 = MemberIndex(Set=panel_4, Member=python)  # -> Index, Count
panel_5 = Panel(item.Item1)
tsort = SortText(Keys=item_3, Values=item_2, Culture=127)  # -> Keys, Values
tsort_2 = SortText(Keys=item_3, Values=item_4, Culture=127)  # -> Keys, Values
item_5 = ListItem(List=panel_5, Index=mindex_2.Index, Wrap=True)
trim = TrimTree(Tree=item_5, Depth=1)
cset_2 = CreateSet(List=tsort_2.Values)  # -> Set, Map
graft = GraftTree(Tree=tsort.Values, IncludeEmptyLists=True, IncludeNullItems=True)
graft_2 = GraftTree(Tree=tsort_2.Keys, IncludeEmptyLists=True, IncludeNullItems=True)
graft_3 = GraftTree(Tree=tsort_2.Values, IncludeEmptyLists=True, IncludeNullItems=True)
ma = MassAddition(Input=trim)  # -> Result, PartialResults
nullrep = ReplaceNulls(Items=ma.Result, Replacements="0")  # -> Items, Count
addition_2 = Addition(A=nullrep.Items, B=series)
data_2 = Data(addition_2)
pt = ConstructPoint(XCoordinate=0, YCoordinate=0, ZCoordinate=data_2)
xy = XYPlane(Origin=pt)
project = Project(Geometry=graft(data), Plane=xy)  # -> simplify(Geometry), Transform
projected_floor_curves = Geometry(project.Geometry)
first_last = FirstLast(List=projected_floor_curves)  # -> FirstValue, LastValue
first_last_2 = FirstLast(List=projected_floor_curves)  # -> FirstValue, LastValue
facade = Loft(
    Curves=[first_last.FirstValue, first_last_2.LastValue],
    Options={Adjust=False, Closed=False, LoftEnds=0, LoftSimp=0, LoftType=0, Rebuild=10, Refit=0.01})  # -> simplify(Loft)
geo_3 = Geometry(flatten(facade))
cap = CapHoles(Brep=geo_3)
item_6 = ListItem(List=cap, Index=mindex.Index, Wrap=True)
item_7 = ListItem(List=geo_3, Index=mindex.Index, Wrap=True)
tsort_3 = SortText(Keys=item_3, Values=item_6, Culture=127)  # -> Keys, Values
tsort_4 = SortText(Keys=item_3, Values=item_7, Culture=127)  # -> Keys, Values
graft_4 = GraftTree(Tree=tsort_3.Values, IncludeEmptyLists=True, IncludeNullItems=True)  # -> simplify(SubMass)
graft_5 = GraftTree(Tree=tsort_4.Values, IncludeEmptyLists=True, IncludeNullItems=True)
debrep = DeconstructBrep(Brep=graft_5)  # -> simplify(Faces), Edges, Vertices
boundary = BoundarySurfaces(Edges=project.Geometry)
floor_surfaces = Geometry(boundary)
cull_i = CullIndex(List=floor_surfaces, Indices=-1, Wrap=True)
group = Group(Objects=cull_i)  # -> flatten(Group)
item_8 = ListItem(List=group, Index=mindex.Index, Wrap=True)
tsort_5 = SortText(Keys=item_3, Values=item_8, Culture=127)  # -> Keys, Values
ungroup = Ungroup(Group=tsort_5.Values)  # -> simplify(Objects)
lng = ListLength(List=ungroup)
geo_4 = Geometry(ungroup)
dup = DuplicateData(Data=graft, Number=lng, Order=True)  # -> simplify(Data)
dup_2 = DuplicateData(Data=graft_2, Number=lng, Order=True)  # -> simplify(Data)
dup_3 = DuplicateData(Data=graft_3, Number=lng, Order=True)  # -> simplify(Data)
area = Area(Geometry=geo_4)  # -> Area, Centroid
xy_2 = XYPlane(Origin=area.Centroid)
pdecon = Deconstruct(Point=area.Centroid)  # -> XComponent, YComponent, simplify(ZComponent)
group_2 = Group(Objects=xy_2)
long = LongestList(ListA=debrep.Faces, ListB=group_2, PaddingMode=2)  # -> graft(ListA), ListB
ungroup_2 = Ungroup(Group=long.ListB)
sec = BrepPlane(Brep=long.ListA, Plane=ungroup_2)  # -> Curves, Points
shift = ShiftPaths(Data=sec.Curves, Offset=-1)
srfsplit = SurfaceSplit(Surface=long.ListA, Curves=shift)
first_last_3 = FirstLast(List=boundary)  # -> FirstValue, LastValue
data_3 = Data(simplify(graft(tsort.Values)))
data_4 = Data(simplify(graft(tsort_2.Keys)))
data_5 = Data(simplify(graft(tsort_2.Values)))
trim_2 = TrimTree(Tree=srfsplit, Depth=1)
trim_3 = TrimTree(Tree=trim_2, Depth=1)
rint = RegionIntersection(CurvesA=flatten(first_last_3.FirstValue), CurvesB=first_last_3.LastValue)
area_2 = Area(Geometry=trim_3)  # -> Area, Centroid
boundary_2 = BoundarySurfaces(Edges=rint)
pdecon_2 = Deconstruct(Point=area_2.Centroid)  # -> XComponent, YComponent, ZComponent
panel_6 = Panel("""RL
Area
Typology
SubBuildID
BuildID""")
panel_7 = Panel("""Typology
SubBuildID
BuildID""")
panel_8 = Panel("""Area
Typology
SubBuildID
BuildID""")
merge = Merge(Data1=simplify(graft(cset_2.Set)))  # -> simplify(Result)
merge_2 = Merge(Data1=simplify(graft(graft)), Data2=simplify(graft(graft_2)), Data3=simplify(graft(graft_3)))  # -> simplify(Result)
merge_3 = Merge(Data1=simplify(graft(dup)), Data2=simplify(graft(dup_2)), Data3=simplify(graft(dup_3)))  # -> simplify(Result)
panel_9 = Panel("""Typology
SubBuildID
BuildID""")
sdiff = SolidDifference(BrepsA=first_last_3.LastValue, BrepsB=flatten(boundary_2))
trim_4 = TrimTree(Tree=graft_5, Depth=1)
sort = SortList(Keys=pdecon_2.ZComponent, ValuesA=trim_3)  # -> Keys, ValuesA
lng_2 = ListLength(List=debrep.Faces)
group_3 = Group(Objects=sdiff)
partition = PartitionList(List=sort.ValuesA, Size=lng_2)
json_2 = JSON(Key=panel_7, Value=merge_3)
item_9 = ListItem(List=flatten(group_3), Index=mindex.Index, Wrap=True)
join = BrepJoin(Breps=partition)  # -> simplify(Breps), Closed
cap_2 = CapHoles(Brep=trim_4)
geo_5 = Geometry(geo_4)
area_3 = Area(Geometry=geo_5)  # -> Area, Centroid
merge_4 = Merge(
    Data1=simplify(graft(pdecon.ZComponent)),
    Data2=simplify(graft(area_3.Area)),
    Data3=simplify(graft(dup)),
    Data4=simplify(graft(dup_2)),
    Data5=simplify(graft(dup_3)))  # -> simplify(Result)
json_3 = JSON(Key=panel_6, Value=merge_4)
trim_5 = TrimTree(Tree=json_3, Depth=1)
tsort_6 = SortText(Keys=item_3, Values=item_9, Culture=127)  # -> Keys, simplify(Values)
ungroup_3 = Ungroup(Group=tsort_6.Values)
trim_6 = TrimTree(Tree=ungroup_3, Depth=1)
area_4 = Area(Geometry=trim_6)  # -> Area, Centroid
sunion = SolidUnion(Breps=cap_2)
json_4 = JSON(Key="BuildID", Value=merge)
json_5 = JSON(Key=panel_9, Value=merge_2)
sub_mass_properties = Data(json_5)
floorplate_properties = Data(trim_5)
full_mass_properties = Data(json_4)
facade_properties = Data(json_2)
full_mass = Data(simplify(graft(sunion)))
floorplates = Data(geo_5)
sub_mass = Geometry(graft_4)
facade_2 = Data(join.Breps)
ungroup_4 = Ungroup(Group=tsort_6.Values)
dup_4 = DuplicateDataMatch(SourceDataTree=ungroup_4, SecondaryData1=data_3)  # -> SourceData, SecondaryData1
dup_5 = DuplicateDataMatch(SourceDataTree=ungroup_4, SecondaryData1=data_4)  # -> SourceData, SecondaryData1
dup_6 = DuplicateDataMatch(SourceDataTree=ungroup_4, SecondaryData1=data_5)  # -> SourceData, SecondaryData1
trim_7 = TrimTree(Tree=dup_4.SecondaryData1, Depth=1)
trim_8 = TrimTree(Tree=dup_5.SecondaryData1, Depth=1)
trim_9 = TrimTree(Tree=dup_6.SecondaryData1, Depth=1)
merge_5 = Merge(
    Data1=simplify(graft(area_4.Area)),
    Data2=simplify(graft(trim_7)),
    Data3=simplify(graft(trim_8)),
    Data4=simplify(graft(trim_9)))  # -> simplify(Result)
json_6 = JSON(Key=panel_8, Value=merge_5)
trim_10 = TrimTree(Tree=json_6, Depth=1)
roof_properties = Data(trim_10)
trim_11 = TrimTree(Tree=ungroup_4, Depth=1)
roof_properties_2 = ClusterOutput(roof_properties)
full_mass_2 = ClusterOutput(full_mass)
full_mass_properties_2 = ClusterOutput(full_mass_properties)
sub_mass_2 = ClusterOutput(sub_mass)
sub_mass_properties_2 = ClusterOutput(sub_mass_properties)
facade_3 = ClusterOutput(facade_2)
floorplates_2 = ClusterOutput(floorplates)
floorplate_properties_2 = ClusterOutput(floorplate_properties)
facade_properties_2 = ClusterOutput(facade_properties)
roof = Data(trim_11)
roof_2 = ClusterOutput(roof)

# ==== cluster TowerByCurvesZHeight

# ---- group: Cluster Input
building_curves = ClusterInput()

# ----
building_curves_2 = Curve(building_curves)
objatts = ObjectAttributes(ObjectOrAttributes=building_curves_2)  # -> Name, LayerName, LayerFullPath, Color, MaterialName, LinetypeName, GroupIndices, PlotWeight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
panel = Panel("""BuildID
Typology
F2F
Levels""")
json = JSON(Key=objatts.UserDataKeys, Value=objatts.UserDataValues)
read = ReadJSON(Object=json, Key=panel)
mindex = MemberIndex(Set=panel, Member="F2F")  # -> Index, Count
mindex_2 = MemberIndex(Set=panel, Member="Levels")  # -> Index, Count
mindex_3 = MemberIndex(Set=panel, Member="BuildID")  # -> Index, Count
flip = FlipMatrix(Data=read)
branch = TreeBranch(Tree=flip, Path=mindex.Index, MaintainPaths=True)
branch_2 = TreeBranch(Tree=flip, Path=mindex_2.Index, MaintainPaths=True)
branch_3 = TreeBranch(Tree=flip, Path=mindex_3.Index, MaintainPaths=True)
cset = CreateSet(List=branch_3)  # -> Set, Map
tsort = SortText(Keys=cset.Set, Values=cset.Set, Culture=127)  # -> Keys, Values
read_2 = ReadJSON(Object=json, Key="Typology")  # -> flatten(Value)
read_3 = ReadJSON(Object=json, Key="BuildID")  # -> flatten(Value)
mindex_4 = MemberIndex(Set=branch_3, Member=tsort.Keys)  # -> Index, Count
cset_2 = CreateSet(List=flatten(read_3))  # -> Set, Map
subbuildid_naming = Panel("""A
B
C
D
E
F
G
H
I
J
K
L
M
M
O
P""")

# ----
# SORT VIA BUILDID
item = ListItem(List=branch, Index=mindex_4.Index, Wrap=True)
item_2 = ListItem(List=branch_2, Index=mindex_4.Index, Wrap=True)
item_3 = ListItem(List=building_curves_2, Index=mindex_4.Index, Wrap=True)

tsort_2 = SortText(Keys=cset_2.Set, Values=cset_2.Set, Culture=127)  # -> Keys, Values
mindex_5 = MemberIndex(Set=flatten(read_3), Member=tsort_2.Keys)  # -> Index, Count
area = Area(Geometry=item_3)  # -> Area, Centroid
pdecon = Deconstruct(Point=area.Centroid)  # -> XComponent, YComponent, ZComponent
item_4 = ListItem(List=read_2, Index=mindex_5.Index, Wrap=True)
item_5 = ListItem(List=read_3, Index=mindex_5.Index, Wrap=True)

# ----
# SORT VIA Z HEIGHT
sort = SortList(Keys=pdecon.ZComponent, ValuesA=item)  # -> Keys, ValuesA
sort_2 = SortList(Keys=pdecon.ZComponent, ValuesA=item_2)  # -> Keys, ValuesA
sort_3 = SortList(Keys=pdecon.ZComponent, ValuesA=item_3)  # -> Keys, ValuesA

sort_4 = SortList(Keys=pdecon.ZComponent, ValuesA=item_4)  # -> Keys, ValuesA
sort_5 = SortList(Keys=pdecon.ZComponent, ValuesA=item_5)  # -> Keys, ValuesA

addition = Addition(A=sort_2.ValuesA, B=1)
series = Series(Start=0, Step=sort.ValuesA, Count=addition)  # -> simplify(Series)
item_6 = ListItem(List=series, Index=0, Wrap=True)  # -> Item1, Item
trim = TrimTree(Tree=item_6.Item1, Depth=1)
cull_i = CullIndex(List=trim, Indices=-1, Wrap=True)
# PROJECTING FLOOR CURVES ONTO CORRECT FLOOR HEIGHT
ins = InsertItems(List=cull_i, Item=0, Indices=0, Wrap=True)
data = Data(simplify(graft(ins)))
trim_2 = TrimTree(Tree=data, Depth=1)
ma = MassAddition(Input=trim_2)  # -> Result, simplify(graft(PartialResults))
addition_2 = Addition(A=series, B=ma.PartialResults)
pt = ConstructPoint(XCoordinate=0, YCoordinate=0, ZCoordinate=addition_2)
crv = Curve(simplify(graft(sort_3.ValuesA)))
xy = XYPlane(Origin=pt)
project = Project(Geometry=crv, Plane=xy)  # -> simplify(Geometry), Transform
boundary = BoundarySurfaces(Edges=project.Geometry)

projected_floor_curves = Geometry(project.Geometry)
first_last = FirstLast(List=projected_floor_curves)  # -> FirstValue, LastValue
first_last_2 = FirstLast(List=projected_floor_curves)  # -> FirstValue, LastValue
facade = Loft(
    Curves=[first_last.FirstValue, first_last_2.LastValue],
    Options={Adjust=False, Closed=False, LoftEnds=0, LoftSimp=0, LoftType=0, Rebuild=10, Refit=0.01})  # -> simplify(Loft)
floor_surfaces = Geometry(boundary)
cull_i_2 = CullIndex(List=floor_surfaces, Indices=-1, Wrap=True)
geo = Geometry(facade)
group = Group(Objects=cull_i_2)
trim_3 = TrimTree(Tree=geo, Depth=1)
trim_4 = TrimTree(Tree=geo, Depth=1)
trim_5 = TrimTree(Tree=group, Depth=2)
cap = CapHoles(Brep=trim_3)
graft = GraftTree(Tree=cap, IncludeEmptyLists=True, IncludeNullItems=True)  # -> simplify(SubMass)
ungroup = Ungroup(Group=trim_5)  # -> simplify(Objects)
graft_2 = GraftTree(Tree=trim_4, IncludeEmptyLists=True, IncludeNullItems=True)
cset_3 = CreateSet(List=sort_5.ValuesA)  # -> Set, Map
graft_3 = GraftTree(Tree=sort_4.ValuesA, IncludeEmptyLists=True, IncludeNullItems=True)
graft_4 = GraftTree(Tree=sort_5.ValuesA, IncludeEmptyLists=True, IncludeNullItems=True)
lng = ListLength(List=ungroup)
geo_2 = Geometry(ungroup)
dup = DuplicateData(Data=graft_3, Number=lng, Order=True)  # -> simplify(Data)
dup_2 = DuplicateData(Data=graft_4, Number=lng, Order=True)  # -> simplify(Data)

debrep = DeconstructBrep(Brep=graft_2)  # -> simplify(Faces), Edges, Vertices
area_2 = Area(Geometry=geo_2)  # -> Area, Centroid
xy_2 = XYPlane(Origin=area_2.Centroid)
group_2 = Group(Objects=xy_2)
long = LongestList(ListA=debrep.Faces, ListB=group_2, PaddingMode=2)  # -> graft(ListA), ListB
ungroup_2 = Ungroup(Group=long.ListB)
sec = BrepPlane(Brep=long.ListA, Plane=ungroup_2)  # -> Curves, Points
shift = ShiftPaths(Data=sec.Curves, Offset=-1)
# CREATING FACADE
srfsplit = SurfaceSplit(Surface=long.ListA, Curves=shift)
trim_6 = TrimTree(Tree=srfsplit, Depth=1)
trim_7 = TrimTree(Tree=trim_6, Depth=1)
area_3 = Area(Geometry=trim_7)  # -> Area, Centroid
pdecon_2 = Deconstruct(Point=area_3.Centroid)  # -> XComponent, YComponent, ZComponent
sort_6 = SortList(Keys=pdecon_2.ZComponent, ValuesA=trim_7)  # -> Keys, ValuesA
lng_2 = ListLength(List=debrep.Faces)
partition = PartitionList(List=sort_6.ValuesA, Size=lng_2)
join = BrepJoin(Breps=partition)  # -> simplify(Breps), Closed
trim_8 = TrimTree(Tree=join.Breps, Depth=1)
facade_2 = Data(trim_8)

# ----
# EXTRACTING FULL MASS PROPERTIES
panel_2 = Panel("""BuildID
Total Floors
GBA
RL""")

# ----
# EXTRACTING ROOF PROPERTIES
panel_3 = Panel("""Area
Typology
SubBuildID
BuildID""")

# ----
# CREATING FULL MASS
cap_2 = CapHoles(Brep=trim_4)
sunion = SolidUnion(Breps=cap_2)
full_mass = Data(simplify(graft(sunion)))

# ----
# CREATING FLOORPLATES
geo_3 = Geometry(geo_2)
floorplates = Data(geo_3)

# ----
# CREATING SUB MASS
trim_9 = TrimTree(Tree=graft, Depth=1)
sub_mass = Geometry(trim_9)

full_mass_2 = ClusterOutput(full_mass)
sub_mass_2 = ClusterOutput(sub_mass)
facade_3 = ClusterOutput(facade_2)
floorplates_2 = ClusterOutput(floorplates)

first_last_3 = FirstLast(List=boundary)  # -> FirstValue, LastValue
rint = RegionIntersection(CurvesA=flatten(first_last_3.FirstValue), CurvesB=first_last_3.LastValue)
boundary_2 = BoundarySurfaces(Edges=rint)

trim_10 = TrimTree(Tree=first_last_3.LastValue, Depth=1)
lng_3 = ListLength(List=trim_10)
split = SplitList(List=subbuildid_naming, Index=lng_3)  # -> ListA, ListB
graft_5 = GraftTree(Tree=split.ListA, IncludeEmptyLists=True, IncludeNullItems=True)
dup_3 = DuplicateData(Data=graft_5, Number=lng, Order=True)  # -> simplify(Data)

pdecon_3 = Deconstruct(Point=area_2.Centroid)  # -> XComponent, YComponent, simplify(ZComponent)
area_4 = Area(Geometry=geo_3)  # -> Area, Centroid
# EXTRACTING FLOORPLATE PROPERTIES
panel_4 = Panel("""RL
Area
Typology
SubBuildID
BuildID""")
merge = Merge(
    Data1=simplify(graft(pdecon_3.ZComponent)),
    Data2=simplify(graft(area_4.Area)),
    Data3=simplify(graft(dup)),
    Data4=simplify(graft(dup_3)),
    Data5=simplify(graft(dup_2)))  # -> simplify(Result)
json_2 = JSON(Key=panel_4, Value=merge)
trim_11 = TrimTree(Tree=json_2, Depth=1)
floorplate_properties = Data(trim_11)

trim_12 = TrimTree(Tree=floorplate_properties, Depth=1)
read_4 = ReadJSON(Object=trim_12, Key="RL")
trim_13 = TrimTree(Tree=floorplates, Depth=1)
trim_14 = TrimTree(Tree=area_4.Area, Depth=1)
ma_2 = MassAddition(Input=trim_14)  # -> Result, PartialResults
lng_4 = ListLength(List=trim_13)
first_last_4 = FirstLast(List=read_4)  # -> FirstValue, LastValue
merge_2 = Merge(
    Data1=simplify(graft(cset_3.Set)),
    Data2=simplify(graft(lng_4)),
    Data3=simplify(graft(ma_2.Result)),
    Data4=simplify(graft(first_last_4.LastValue)))  # -> simplify(Result)
json_3 = JSON(Key=panel_2, Value=merge_2)
full_mass_properties = Data(json_3)

# ----
# CREATING ROOF GEOMETRY
sdiff = SolidDifference(BrepsA=first_last_3.LastValue, BrepsB=flatten(boundary_2))
group_3 = Group(Objects=sdiff)
item_7 = ListItem(List=flatten(group_3), Index=mindex_5.Index, Wrap=True)

panel_5 = Panel("""Typology
SubBuildID
BuildID""")
merge_3 = Merge(Data1=simplify(graft(dup)), Data2=simplify(graft(dup_3)), Data3=simplify(graft(dup_2)))  # -> simplify(Result)
# EXTRACTING FACADE PROPERTIES
json_4 = JSON(Key=panel_5, Value=merge_3)
trim_15 = TrimTree(Tree=json_4, Depth=1)
facade_properties = Data(trim_15)

merge_4 = Merge(Data1=simplify(graft(graft_3)), Data2=simplify(graft(graft_5)), Data3=simplify(graft(graft_4)))  # -> simplify(Result)
# EXTRACTING SUB MASS PROPERTIES
panel_6 = Panel("""Typology
SubBuildID
BuildID""")
json_5 = JSON(Key=panel_6, Value=merge_4)
trim_16 = TrimTree(Tree=json_5, Depth=1)
sub_mass_properties = Data(trim_16)

ungroup_3 = Ungroup(Group=item_7)
trim_17 = TrimTree(Tree=ungroup_3, Depth=1)
roof = Data(trim_17)

data_2 = Data(simplify(graft(item_4)))
data_3 = Data(simplify(graft(split.ListA)))
data_4 = Data(simplify(graft(item_5)))
ungroup_4 = Ungroup(Group=item_7)
trim_18 = TrimTree(Tree=ungroup_4, Depth=1)
dup_4 = DuplicateDataMatch(SourceDataTree=ungroup_3, SecondaryData1=data_2)  # -> SourceData, SecondaryData1
dup_5 = DuplicateDataMatch(SourceDataTree=ungroup_3, SecondaryData1=data_3)  # -> SourceData, SecondaryData1
dup_6 = DuplicateDataMatch(SourceDataTree=ungroup_3, SecondaryData1=data_4)  # -> SourceData, SecondaryData1
area_5 = Area(Geometry=trim_18)  # -> Area, Centroid
trim_19 = TrimTree(Tree=dup_4.SecondaryData1, Depth=1)
trim_20 = TrimTree(Tree=dup_5.SecondaryData1, Depth=1)
trim_21 = TrimTree(Tree=dup_6.SecondaryData1, Depth=1)
merge_5 = Merge(
    Data1=simplify(graft(area_5.Area)),
    Data2=simplify(graft(trim_19)),
    Data3=simplify(graft(trim_20)),
    Data4=simplify(graft(trim_21)))  # -> simplify(Result)
json_6 = JSON(Key=panel_3, Value=merge_5)
trim_22 = TrimTree(Tree=json_6, Depth=1)
roof_properties = Data(trim_22)

floorplate_properties_2 = ClusterOutput(floorplate_properties)
roof_2 = ClusterOutput(roof)
roof_properties_2 = ClusterOutput(roof_properties)
full_mass_properties_2 = ClusterOutput(full_mass_properties)
sub_mass_properties_2 = ClusterOutput(sub_mass_properties)
facade_properties_2 = ClusterOutput(facade_properties)

# ==== cluster ClockwiseCurve: Reorders controlpoints of curve to clockwise
crv = ClusterInput()
crv_2 = Curve(crv)
cp = ControlPoints(Curve=crv_2)  # -> simplify(Points), Weights, Knots
shift = ShiftList(List=cp.Points, Shift=1, Wrap=True)
pdecon = Deconstruct(Point=cp.Points)  # -> XComponent, YComponent, ZComponent
pdecon_2 = Deconstruct(Point=shift)  # -> XComponent, YComponent, ZComponent
expression = Expression(x=pdecon.XComponent, y=pdecon_2.XComponent, z=pdecon.YComponent, u=pdecon_2.YComponent, Expression="(y-x)*(u+z)")
ma = MassAddition(Input=expression)  # -> Result, PartialResults
larger = LargerThan(FirstNumber=ma.Result, SecondNumber=0)  # -> simplify(LargerThan), OrEqualTo
dispatch = Dispatch(List=simplify(graft(crv_2)), DispatchPattern=larger.LargerThan)  # -> ListA, ListB
flip = FlipCurve(Curve=dispatch.ListB)  # -> Curve, Flag
merge = Merge(Data1=dispatch.ListA, Data2=flip.Curve)  # -> simplify(flatten(Result))
unflatten = UnflattenTree(Tree=merge, Guide=crv_2)
crv_3 = Curve(unflatten)
crv_4 = ClusterOutput(crv_3)
