# Grasshopper definition Curve method.ghx (Grasshopper 1.0.7)
# plug-ins: treesloth01, Redback, Human, Bifocals

panel = Panel("""Curve
Curve
Curve
Curve""")
dpipeline = DynamicGeometryPipeline(
    LayerFilter="Layer 01::Input Curves",
    TypeFilter="Curve",
    NameFilter="*",
    GroupByLayer=False,
    GroupByType=False,
    IncludeHidden=True,
    IncludeLocked=True,
    enableFullPath=True,
    listenToAttributes=True)
panel_2 = Panel("""Y
Y
X
X""")
cluster = Cluster(curves=dpipeline)  # -> roof_2, floors_2, facade_2, mass, json_4
panel_3 = Panel("""Resi
Comm
Resi
Resi""")
panel_4 = Panel("""3
3
3
3""")
output = DataOutput(
    Roofs=cluster.roof_2,
    Floors=cluster.floors_2,
    Facades=cluster.facade_2,
    Mass=cluster.mass,
    Json=cluster.json_4,
    Destination="C:\Users\b-mbuckley\Documents\Hackathon2018\Curve Method.ghdata")
panel_5 = Panel("""3
15
23
19""")
panel_6 = Panel("""A
A
A
A""")
entwine = Entwine(Branch00=panel_2, Branch01=panel_3, Branch02=panel_4, Branch03=panel_5, Branch04=panel_6, FlattenInputs=True)  # -> simplify(Result)

keysearch = KeyValueSearch(Search="BuildID")
keysearch_2 = KeyValueSearch(Search="SubBuildID")
bucketsimitems = BucketSimItems(flatlist=flatten(keysearch), synchronous=flatten(keysearch_2))  # -> buckets_2, synchbuckets_2, synchbuckets2_2, synchbuckets3_2
panel_7 = Panel(keysearch_2)
explode = Explode(Curve=bucketsimitems.synchbuckets2_2, Recursive=True)  # -> Segments, Vertices
panel_8 = Panel(bucketsimitems.buckets_2)
item = ListItem(List=explode.Vertices, Index=0, Wrap=True)
pdecon = Deconstruct(Point=item)  # -> XComponent, YComponent, ZComponent
shift = ShiftPaths(Data=pdecon.ZComponent, Offset=-1)
sort = SortList(Keys=shift, ValuesA=bucketsimitems.synchbuckets2_2)  # -> Keys, ValuesA
branch = TreeBranch(Tree=sort.ValuesA, Path=Slider(0, range=0..1), MaintainPaths=True)
project = Project(Geometry=sort.ValuesA, Plane=PlaneXY(0, 0, 0))  # -> Geometry, Transform
crossref = CrossReference(ListA=project.Geometry, ListB=project.Geometry, CrossMode=1)  # -> ListA, ListB
ccx = CurveCurve(CurveA=crossref.ListA, CurveB=crossref.ListB)  # -> Points, ParamsA, ParamsB
panel_9 = Panel(sort.ValuesA)

panel_10 = Panel("""0.7
0.8""")
panel_11 = Panel("""Resi
Com""")
input = DataInput(Destination="C:\Users\b-mbuckley\Documents\Hackathon2018\Curve Method.ghdata")  # -> Roofs, Floors, Facades, Mass, Json
json = JSON(Key=panel_11, Value=panel_10)
cluster_2 = Cluster_2(O_4=json, G=input.Floors, O=input.Json, O_2=input.Json, O_3=input.Json)
output_2 = DataOutput(AreaCal=cluster_2, Destination="C:\Users\b-mbuckley\Documents\Hackathon2018\Area Cals.ghdata")
input_2 = DataInput(Destination="C:\Users\b-mbuckley\Documents\Hackathon2018\Area Cals.ghdata")
panel_12 = Panel(input_2)

# ==== cluster BucketSimItems
synchronous2 = ClusterInput()
flatlist = ClusterInput()
synchronous3 = ClusterInput()
synchronous = ClusterInput()
flatlist_2 = Data(flatten(flatlist))
synchronous2_2 = Data(flatten(synchronous2))
synchronous3_2 = Data(flatten(synchronous3))
synchronous_2 = Data(flatten(synchronous))
data = Data(simplify(graft(synchronous2_2)))
data_2 = Data(simplify(graft(synchronous3_2)))
data_3 = Data(simplify(graft(flatlist_2)))
data_4 = Data(simplify(graft(synchronous_2)))
cset = CreateSet(List=flatlist_2)  # -> Set, Map
mindex = MemberIndex(Set=cset.Set, Member=flatlist_2)  # -> flatten(Index), Count
viewer = ParamViewer(data_3)
replace = ReplacePaths(Data=data_3, Search=viewer, Replace=mindex.Index)
replace_2 = ReplacePaths(Data=data, Search=viewer, Replace=mindex.Index)
replace_3 = ReplacePaths(Data=data_2, Search=viewer, Replace=mindex.Index)
replace_4 = ReplacePaths(Data=data_4, Search=viewer, Replace=mindex.Index)
buckets = Data(replace)
synchbuckets2 = Data(replace_2)
synchbuckets3 = Data(replace_3)
synchbuckets = Data(replace_4)
buckets_2 = ClusterOutput(buckets)
synchbuckets2_2 = ClusterOutput(synchbuckets2)
synchbuckets3_2 = ClusterOutput(synchbuckets3)
synchbuckets_2 = ClusterOutput(synchbuckets)

# ==== cluster Cluster
curves = ClusterInput()
clockcrv = ClockwiseCurve(crv=curves)
data = Data(clockcrv)
objatts = ObjectAttributes(ObjectOrAttributes=data)  # -> Name, LayerName, LayerFullPath, Color, MaterialName, LinetypeName, GroupIndices, PlotWeight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
panel = Panel("""BuildID
Typology
F2F
Levels
SubBuildID""")
json = JSON(Key=objatts.UserDataKeys, Value=objatts.UserDataValues)
read = ReadJSON(Object=json, Key=panel)
json_2 = JSON(Key=objatts.UserDataKeys, Value=objatts.UserDataValues)
flip = FlipMatrix(Data=read)
panel_2 = Panel(read)
branch = TreeBranch(Tree=simplify(flip), Path="3", MaintainPaths=True)  # -> graft(Branch)
branch_2 = TreeBranch(Tree=simplify(flip), Path="2", MaintainPaths=True)  # -> graft(Branch)
branch_3 = TreeBranch(Tree=flip, Path="0", MaintainPaths=True)
branch_4 = TreeBranch(Tree=flip, Path="4", MaintainPaths=True)
addition = Addition(A=branch, B=1)
concat = Concatenate(FragmentA=branch_3, FragmentB=branch_4)
series = Series(Start=0, Step=branch_2, Count=addition)  # -> simplify(Series)
panel_3 = Panel(concat)
python = GhPythonScript(ID=concat)  # -> StackID
# ---------- python: Python ----------
__author__ = "B-MBuckley"
__version__ = "2018.10.25"

import rhinoscriptsyntax as rs

StackID = []

for i in range(len(ID)-1):
    StackID.append(ID[0:i+1])
# ---------- end python ----------
item = ListItem(List=series, Index=0, Wrap=True)  # -> flatten(Item1), Item
panel_4 = Panel(item.Item1)
mindex = MemberIndex(Set=panel_3, Member=python)  # -> Index, Count
item_2 = ListItem(List=panel_4, Index=mindex.Index, Wrap=True)
trim = TrimTree(Tree=item_2, Depth=1)
ma = MassAddition(Input=trim)  # -> Result, PartialResults
nullrep = ReplaceNulls(Items=ma.Result, Replacements="0")  # -> Items, Count
addition_2 = Addition(A=nullrep.Items, B=series)
data_2 = Data(addition_2)
pt = ConstructPoint(XCoordinate=0, YCoordinate=0, ZCoordinate=data_2)
xy = XYPlane(Origin=pt)
project = Project(Geometry=graft(data), Plane=xy)  # -> Geometry, Transform
boundary = BoundarySurfaces(Edges=project.Geometry)
first_last = FirstLast(List=project.Geometry)  # -> FirstValue, LastValue
first_last_2 = FirstLast(List=project.Geometry)  # -> FirstValue, LastValue
first_last_3 = FirstLast(List=boundary)  # -> FirstValue, LastValue
first_last_4 = FirstLast(List=boundary)  # -> FirstValue, LastValue
first_last_5 = FirstLast(List=boundary)  # -> FirstValue, LastValue
index = ItemIndex(List=boundary, Item=first_last_4.LastValue)
sdiff = SolidDifference(BrepsA=first_last_5.LastValue, BrepsB=flatten(first_last_5.FirstValue))
facade = Loft(
    Curves=[first_last.FirstValue, first_last_2.LastValue],
    Options={Adjust=False, Closed=False, LoftEnds=0, LoftSimp=0, LoftType=0, Rebuild=10, Refit=0.01})  # -> simplify(Loft)
json_3 = Data(json)

floors = CullIndex(List=boundary, Indices=index, Wrap=True)  # -> simplify(List)

roof = Surface(simplify(sdiff))
full_mass = CapHoles(Brep=facade)  # -> simplify(Brep)

# ---- group: List
facade_2 = ClusterOutput(facade)

# ---- group: Surface
floors_2 = ClusterOutput(floors)

# ---- group: Loft
mass = ClusterOutput(full_mass)

# ---- group: Mass
json_4 = ClusterOutput(json_3)

# ---- group: Cluster Output
roof_2 = ClusterOutput(roof)

# ==== cluster Cluster_2
G = ClusterInput()
O = ClusterInput()
O_2 = ClusterInput()
O_3 = ClusterInput()
O_4 = ClusterInput()
area = Area(Geometry=G)  # -> Area, Centroid
dpipeline = DynamicGeometryPipeline(
    LayerFilter="Site",
    TypeFilter="Curve",
    NameFilter="*",
    GroupByLayer=False,
    GroupByType=False,
    IncludeHidden=True,
    IncludeLocked=True,
    enableFullPath=False,
    listenToAttributes=True)
read = ReadJSON(Object=O, Key="BuildID")
read_2 = ReadJSON(Object=O_2, Key="SubBuildID")
read_3 = ReadJSON(Object=O_3, Key="Typology")
srf = Surface(dpipeline)
area_2 = Area(Geometry=srf)  # -> Area, Centroid
pdecon = Deconstruct(Point=area.Centroid)  # -> XComponent, YComponent, ZComponent
flatten = FlattenTree(Tree=read_3, Path="{0}")
cset = CreateSet(List=flatten)  # -> Set, Map
data = Data(read)
flatten_2 = FlattenTree(Tree=data, Path="{0}")
cset_2 = CreateSet(List=flatten_2)  # -> Set, Map
read_4 = ReadJSON(Object=O_4, Key=cset.Set)
sort = SortList(Keys=pdecon.ZComponent, ValuesA=area.Area)  # -> Keys, ValuesA
panel = Panel(read_2)
python = GhPythonScript(ID=read_2)  # -> StackID; same code as python
mindex = MemberIndex(Set=flatten_2, Member=cset_2.Set)  # -> Index, Count
long = LongestList(ListA=sort.ValuesA, ListB=read, ListC=read_2, ListD=read_3, PaddingMode=2)  # -> ListA, ListB, ListC, ListD, ListE
multiplication = Multiplication(A=read_4, B=sort.ValuesA)
panel_2 = Panel(sort.ValuesA)
item = ListItem(List=read, Index=mindex.Index, Wrap=True)
mindex_2 = MemberIndex(Set=panel, Member=python)  # -> Index, Count
item_2 = ListItem(List=read_2, Index=mindex.Index, Wrap=True)
panel_3 = Panel(item_2)
panel_4 = Panel(item)
panel_5 = Panel(sort.ValuesA)
panel_6 = Panel(long.ListB)
panel_7 = Panel(long.ListC)
panel_8 = Panel(long.ListD)
panel_9 = Panel("""BuildID
GBA
SubBuildID
Typology
NSA/NLA""")
graft = GraftTree(Tree=panel_6, IncludeEmptyLists=True, IncludeNullItems=True)  # -> simplify(Tree)
graft_2 = GraftTree(Tree=panel_5, IncludeEmptyLists=True, IncludeNullItems=True)  # -> simplify(Tree)
graft_3 = GraftTree(Tree=panel_7, IncludeEmptyLists=True, IncludeNullItems=True)  # -> simplify(Tree)
graft_4 = GraftTree(Tree=panel_8, IncludeEmptyLists=True, IncludeNullItems=True)  # -> simplify(Tree)
merge = Merge(Data1=graft, Data2=graft_2, Data3=graft_3, Data4=graft_4, Data5=multiplication)
json = JSON(Key=panel_9, Value=merge)
shift = ShiftPaths(Data=json, Offset=-1)
data_2 = Data(read_2)
data_3 = Data(read)
flatten_3 = FlattenTree(Tree=data_3, Path="{0}")
flatten_4 = FlattenTree(Tree=data_2, Path="{0}")
python_2 = GhPythonScript(List=shift)  # -> flatten(JSON); inputs List: list
# ---------- python_2: Python ----------
__author__ = "B-MBuckley"
__version__ = "2018.10.25"

import rhinoscriptsyntax as rs
import json

outob = []
for i in List:
    outob.append(json.loads(i))

JSON = json.dumps(outob)
# ---------- end python_2 ----------
cset_3 = CreateSet(List=flatten_3)  # -> Set, Map
mindex_3 = MemberIndex(Set=flatten_3, Member=cset_3.Set)  # -> Index, Count
item_3 = ListItem(List=flatten_4, Index=mindex_3.Index, Wrap=True)
item_4 = ListItem(List=python_2, Index=mindex_3.Index, Wrap=True)
json_2 = JSON(Key=item_3, Value=item_4)
J = ClusterOutput(json_2)

# ==== cluster ClockwiseCurve: Reorders controlpoints of curve to clockwise
crv = ClusterInput()
crv_2 = Curve(crv)
cp = ControlPoints(Curve=crv_2)  # -> simplify(Points), Weights, Knots
shift = ShiftList(List=cp.Points, Shift=1, Wrap=True)
pdecon = Deconstruct(Point=cp.Points)  # -> XComponent, YComponent, ZComponent
pdecon_2 = Deconstruct(Point=shift)  # -> XComponent, YComponent, ZComponent
expression = Expression(x=pdecon.XComponent, y=pdecon_2.XComponent, z=pdecon.YComponent, u=pdecon_2.YComponent, Expression="(y-x)*(u+z)")
ma = MassAddition(Input=expression)  # -> Result, PartialResults
larger = LargerThan(FirstNumber=ma.Result, SecondNumber=0)  # -> simplify(LargerThan), OrEqualTo
dispatch = Dispatch(List=simplify(graft(crv_2)), DispatchPattern=larger.LargerThan)  # -> ListA, ListB
flip = FlipCurve(Curve=dispatch.ListB)  # -> Curve, Flag
merge = Merge(Data1=dispatch.ListA, Data2=flip.Curve)  # -> simplify(flatten(Result))
unflatten = UnflattenTree(Tree=merge, Guide=crv_2)
crv_3 = Curve(unflatten)
crv_4 = ClusterOutput(crv_3)
