# Grasshopper definition Tower by Multiple Breps.ghx (Grasshopper 1.0.7)
# Copyright: Co-de-iT
# plug-ins: Human

# ----
# GEOMETERY INPUT
panel = Panel("BREPS::Brep3")
dpipeline = DynamicGeometryPipeline(
    LayerFilter=panel,
    TypeFilter="Brep",
    NameFilter="*",
    GroupByLayer=False,
    GroupByType=False,
    IncludeHidden=True,
    IncludeLocked=True,
    enableFullPath=True,
    listenToAttributes=True)

tower_by_multiple_breps = TowerByMultipleBreps(geometry=dpipeline)  # -> floorplates_2, floorplate_properties_2, facade_3, facade_properties_2, full_mass_2, full_mass_properties_2, rooftops_2
output = DataOutput(
    Floorplate_Properties=tower_by_multiple_breps.floorplate_properties_2,
    Floorplates=tower_by_multiple_breps.floorplates_2,
    Full_Mass=tower_by_multiple_breps.full_mass_2,
    Facade=tower_by_multiple_breps.facade_3,
    Rooftops=tower_by_multiple_breps.rooftops_2,
    Destination="C:\Users\bekjc\Documents\Hackaton\Hackathon2018\Hackaton Multiple Mass.ghdata")
input = DataInput(Destination="C:\Users\bekjc\Documents\Hackaton\Hackathon2018\Hackaton Multiple Mass.ghdata")  # -> Floorplate_Properties, Floorplates, Full_Mass, Facade, Rooftops
panel_2 = Panel(input.Floorplates)

# ==== cluster TowerByMultipleBreps
geometry = ClusterInput()
# SORT INTO BUILDINGS
geometry_2 = Data(geometry)

getuv = GetUserValue(Geometry=geometry_2, Key="BuildID")
cset = CreateSet(List=getuv)  # -> simplify(graft(Set)), Map
tmatch = MatchText(Text=getuv, Pattern=cset.Set, Case=True)
dispatch = Dispatch(List=geometry_2, DispatchPattern=tmatch)  # -> simplify(ListA), ListB

# ----
# GET LOWEST POINT ON EACH BREP
debrep = DeconstructBrep(Brep=dispatch.ListA)  # -> Faces, Edges, simplify(Vertices)
pdecon = Deconstruct(Point=debrep.Vertices)  # -> XComponent, YComponent, ZComponent
sort = SortList(Keys=pdecon.ZComponent, ValuesA=debrep.Vertices)  # -> reverse(Keys), reverse(ValuesA)
item = ListItem(List=sort.Keys, Index=-1, Wrap=True)  # -> simplify(Item)
utrim = UberTrim(data=item)

# ----
# CALCULATE HEIGHT OF EACH BREP
bbox = BoundingBox(Content=dispatch.ListA, Plane=PlaneXY(0, 0, 0))  # -> Box, Box_2
debox = DeconstructBox(Box=bbox.Box)  # -> Plane, X, Y, Z
dedomain = DeconstructDomain(Domain=debox.Z)  # -> Start, End
subtraction = Subtraction(A=dedomain.End, B=dedomain.Start)

area = Area(Geometry=debrep.Faces)  # -> Area, Centroid
pdecon_2 = Deconstruct(Point=area.Centroid)  # -> XComponent, YComponent, ZComponent
getuv_2 = GetUserValue(Geometry=dispatch.ListA, Key="F2F")
getuv_3 = GetUserValue(Geometry=dispatch.ListA, Key="Typology")
getuv_4 = GetUserValue(Geometry=dispatch.ListA, Key="SubBuildID")
len = TextLength(Text=getuv_4)
utrim_2 = UberTrim(data=len)
cset_2 = CreateSet(List=utrim_2)  # -> Set, Map
sort_2 = SortList(Keys=cset_2.Set)  # -> Keys, ValuesA
num = Number(sort_2.Keys)
num_2 = Number(utrim_2)
mindex = MemberIndex(Set=num_2, Member=num)  # -> Index, Count
lng = ListLength(List=mindex.Index)
trim = TrimTree(Tree=lng, Depth=1)
join = TextJoin(Text=getuv_4, Join="\t")
lng_2 = ListLength(List=trim)
repeat = RepeatData(Data=join, Length=lng_2)
split = TextSplit(Text=repeat, Separators="\t")
item_2 = ListItem(List=split, Index=mindex.Index, Wrap=True)  # -> simplify(Item)
lng_3 = ListLength(List=item_2)
join_2 = TextJoin(Text=item_2, Join="^")
join_3 = TextJoin(Text=lng_3, Join="^")
utrim_3 = UberTrim(data=join_3)
utrim_4 = UberTrim(data=join_2)
larger = LargerThan(FirstNumber=utrim_3, SecondNumber=Slider(1, range=0..1))  # -> LargerThan, OrEqualTo
lng_4 = ListLength(List=larger.LargerThan)
series = Series(Start=0, Step=1, Count=lng_4)
dispatch_2 = Dispatch(List=utrim_4, DispatchPattern=larger.LargerThan)  # -> ListA, ListB
cull = CullPattern(List=series, CullPattern=larger.LargerThan)
split_2 = SplitList(List=utrim_4, Index=cull)  # -> ListA, ListB
split_3 = TextSplit(Text=split_2.ListB, Separators="^")  # -> simplify(Result)
split_4 = TextSplit(Text=split_2.ListA, Separators="^")  # -> simplify(Result)
utrim_5 = UberTrim(data=split_3)
getuv_5 = GetUserValue(Geometry=dispatch.ListA, Key="BuildID")
sort_3 = SortList(Keys=pdecon_2.ZComponent, ValuesA=debrep.Faces, ValuesB=area.Centroid)  # -> Keys, ValuesA, ValuesB
item_3 = ListItem(List=utrim_5, Index=0, Wrap=True)
chars = Characters(Text=getuv_4)  # -> Result, Unicode
len_2 = TextLength(Text=item_3)
series_2 = Series(Start=0, Step=1, Count=len_2)
item_4 = ListItem(List=chars.Result, Index=series_2, Wrap=True)  # -> Item, Item1, Item2

# ----
# NUMBER OF FLOORS
division = Division(A=subtraction, B=getuv_2)
round = Round(Number=division)  # -> simplify(Nearest), Floor, Ceiling

merge = Merge(Data1=item_4.Item)
panel = Panel(getuv_4)
join_4 = TextJoin(Text=item_4.Item)
panel_2 = Panel(round.Nearest)
panel_3 = Panel(join_4)

# ----
# PLANE PER LEVEL
series_3 = Series(Start=utrim, Step=getuv_2, Count=round.Nearest)
pt = ConstructPoint(XCoordinate=0, YCoordinate=0, ZCoordinate=series_3)  # -> simplify(Point)
xy = XYPlane(Origin=pt)

graft = GraftTree(Tree=dispatch.ListA, IncludeEmptyLists=True, IncludeNullItems=True)
sunion = SolidUnion(Breps=dispatch.ListA)
data = Data(getuv_5)

# ---- group: BUILD ID
dup = DuplicateData(Data=graft(getuv_5), Number=graft(round.Nearest), Order=True)  # -> simplify(Data)

# ---- group: SUB BUILD ID
dup_2 = DuplicateData(Data=graft(getuv_4), Number=graft(round.Nearest), Order=True)  # -> simplify(Data)

# ---- group: TYPOLOGY
# TYPOLOGY OF FLOOR
dup_3 = DuplicateData(Data=graft(getuv_3), Number=graft(round.Nearest), Order=True)  # -> simplify(Data)

# ----
# FLOOR PLATE CRVS
sec = BrepPlane(Brep=graft, Plane=xy)  # -> Curves, Points

debrep_2 = DeconstructBrep(Brep=dispatch.ListA)  # -> Faces, Edges, Vertices

# ---- group: all floorplates
boundary = BoundarySurfaces(Edges=sec.Curves)  # -> simplify(Surfaces)

# ----
debrep_3 = DeconstructBrep(Brep=sunion)  # -> Faces, Edges, Vertices
evalsrf = EvaluateSurface(Surface=reparameterize(debrep_2.Faces), Point="0.5,0.5")  # -> Point, Normal, UDirection, VDirection, Frame
utrim_6 = UberTrim(data=boundary)

# ---- group: sort by height to get tops
area_2 = Area(Geometry=utrim_6)  # -> Area, Centroid
pdecon_3 = Deconstruct(Point=area_2.Centroid)  # -> XComponent, YComponent, ZComponent
sort_4 = SortList(Keys=pdecon_3.ZComponent, ValuesFloorplate=utrim_6, ValuesTypology=dup_3, ValuesSubBuildID=dup_2, ValuesBuildID=dup)  # -> reverse(Keys), reverse(ValuesFloorplate), reverse(ValuesTypology), reverse(ValuesSubBuildID), reverse(ValuesBuildID)
item_5 = ListItem(List=sort_4.ValuesFloorplate, Index=0, Wrap=True)

# ----
pdecon_4 = Deconstruct(Point=evalsrf.Point)  # -> XComponent, YComponent, ZComponent
evalsrf_2 = EvaluateSurface(Surface=reparameterize(debrep_3.Faces), Point="0.5,0.5")  # -> Point, Normal, UDirection, VDirection, Frame
panel_4 = Panel("""-1
0""")
sort_5 = SortList(Keys=pdecon_4.ZComponent, ValuesA=debrep_2.Faces)  # -> Keys, ValuesA
devec = DeconstructVector(Vector=evalsrf_2.Normal)  # -> XComponent, YComponent, ZComponent

# ---- group: facade
cull_i = CullIndex(List=sort_5.ValuesA, Indices=panel_4, Wrap=True)  # -> simplify(List)

# ----
geo = Geometry(cull_i)
cull_i_2 = CullIndex(List=sort_4.ValuesFloorplate, Indices=0, Wrap=True)  # -> simplify(List)
equals = Equality(FirstNumber=devec.ZComponent, SecondNumber=Slider(1, range=0..1))  # -> Equality, Inequality

# ---- group: usable space above floor
area_3 = Area(Geometry=item_5)  # -> Area, Centroid
Z = UnitZ(Factor=1)
graft_2 = GraftTree(Tree=getuv_2, IncludeEmptyLists=True, IncludeNullItems=True)
line = LineSDL(Start=area_3.Centroid, Direction=Z, Length=graft_2)

# ----
dispatch_3 = Dispatch(List=debrep_3.Faces, DispatchPattern=equals.Equality)  # -> ListA, ListB
graft_3 = GraftTree(Tree=dispatch.ListA, IncludeEmptyLists=True, IncludeNullItems=True)
utrim_7 = UberTrim(data=dispatch_3.ListA)
bcx = BrepCurve(Brep=graft_3, Curve=line)  # -> Curves, simplify(Points)
group = Group(Objects=dispatch.ListA)
number_slider = Slider(0.1, range=0..0.1)
data_2 = Data(utrim_7)
Z_2 = UnitZ(Factor=Slider(0.5, range=0..1))
null = NullItem(Item=bcx.Points)  # -> NullFlags, InvalidFlags, Description

# ---- group: Typology
item_6 = ListItem(List=sort_4.ValuesTypology, Index=0, Wrap=True)
cull_i_3 = CullIndex(List=sort_4.ValuesTypology, Indices=0, Wrap=True)  # -> simplify(List)
dispatch_4 = Dispatch(List=item_6, DispatchPattern=null.NullFlags)  # -> ListA, ListB
merge_2 = Merge(Data1=dispatch_4.ListA, Data2=cull_i_3)

# ---- group: SubBuildID
item_7 = ListItem(List=sort_4.ValuesSubBuildID, Index=0, Wrap=True)
cull_i_4 = CullIndex(List=sort_4.ValuesSubBuildID, Indices=0, Wrap=True)  # -> simplify(List)
dispatch_5 = Dispatch(List=item_7, DispatchPattern=null.NullFlags)  # -> ListA, ListB
merge_3 = Merge(Data1=dispatch_5.ListA, Data2=cull_i_4)

# ---- group: BuildID
item_8 = ListItem(List=sort_4.ValuesBuildID, Index=0, Wrap=True)
cull_i_5 = CullIndex(List=sort_4.ValuesBuildID, Indices=0, Wrap=True)  # -> simplify(List)
dispatch_6 = Dispatch(List=item_8, DispatchPattern=null.NullFlags)  # -> ListA, ListB
merge_4 = Merge(Data1=dispatch_6.ListA, Data2=cull_i_5)

# ----
area_4 = Area(Geometry=data_2)  # -> Area, Centroid
lng_5 = ListLength(List=area_4.Centroid)
dup_4 = DuplicateData(Data=group, Number=lng_5, Order=True)
neg = Negative(Value=Z_2)
dispatch_7 = Dispatch(List=item_5, DispatchPattern=null.NullFlags)  # -> ListA, ListB
merge_5 = Merge(Data1=dispatch_7.ListA, Data2=cull_i_2)
ungroup = Ungroup(Group=dup_4)  # -> simplify(Objects)
move = Move(Geometry=area_4.Centroid, Motion=neg)  # -> graft(Geometry), Transform
area_5 = Area(Geometry=merge_5)  # -> Area, Centroid
brepinc = PointInBrep(Brep=ungroup, Point=move.Geometry, Strict=False)
subbuild_id = Data(getuv_4)
typology = Data(getuv_3)
build_id = Data(getuv_5)
lng_6 = ListLength(List=cull_i)
pdecon_5 = Deconstruct(Point=area_5.Centroid)  # -> XComponent, YComponent, ZComponent
sort_6 = SortList(
    Keys=pdecon_5.ZComponent,
    ValuesFloorPlate=merge_5,
    ValuesTypology=merge_2,
    ValuesSubBuildID=merge_3,
    ValuesBuildID=merge_4)  # -> Keys, ValuesFloorPlate, ValuesTypology, ValuesSubBuildID, ValuesBuildID
pt_2 = ConstructPoint(XCoordinate=0, YCoordinate=0, ZCoordinate=sort_6.Keys)
xy_2 = XYPlane(Origin=pt_2)
group_2 = Group(Objects=xy_2)
long = LongestList(ListA=geo, ListB=group_2, PaddingMode=2)  # -> ListA, ListB
ungroup_2 = Ungroup(Group=long.ListB)
sec_2 = BrepPlane(Brep=graft(long.ListA), Plane=ungroup_2)  # -> Curves, Points
shift = ShiftPaths(Data=sec_2.Curves, Offset=-1)  # -> simplify(Data)
utrim_8 = UberTrim(data=sec_2.Curves)
srfsplit = SurfaceSplit(Surface=graft(long.ListA), Curves=shift)  # -> simplify(Fragments)
facade = Data(srfsplit)
utrim_9 = UberTrim(data=facade)
area_6 = Area(Geometry=utrim_9)  # -> Area, Centroid
pdecon_6 = Deconstruct(Point=area_6.Centroid)  # -> XComponent, YComponent, ZComponent
sort_7 = SortList(Keys=pdecon_6.ZComponent, ValuesA=utrim_9)  # -> Keys, ValuesA, ValuesC, ValuesD, ValuesE
partition = PartitionList(List=sort_7.ValuesA, Size=lng_6)
dispatch_8 = Dispatch(List=ungroup, DispatchPattern=brepinc)  # -> ListA, ListB
dispatch_9 = Dispatch(List=ungroup, DispatchPattern=brepinc)  # -> ListA, ListB
geo_2 = Geometry(dispatch_8.ListA)
panel_5 = Panel("""RL
Typology
SubBuildID
BuildID""")
join_5 = BrepJoin(Breps=partition)  # -> Breps, Closed
merge_6 = Merge(Data2=graft(sort_6.ValuesTypology), Data3=graft(sort_6.ValuesSubBuildID), Data4=graft(sort_6.ValuesBuildID))  # -> simplify(Result)
merge_7 = Merge(
    Data1=graft(sort_6.Keys),
    Data2=graft(sort_6.ValuesTypology),
    Data3=graft(sort_6.ValuesSubBuildID),
    Data4=graft(sort_6.ValuesBuildID))  # -> simplify(Result)
utrim_10 = UberTrim(data=join_5.Breps)
panel_6 = Panel("""Typology
SubBuildID
BuildID""")
json = JSON(Key=panel_5, Value=merge_7)

cset_3 = CreateSet(List=data)  # -> Set, Map
utrim_11 = UberTrim(data=sunion)
json_2 = JSON(Key="BuildID", Value=cset_3.Set)
full_mass = Data(utrim_11)
full_mass_properties = Data(json_2)
full_mass_2 = ClusterOutput(full_mass)
full_mass_properties_2 = ClusterOutput(full_mass_properties)

utrim_12 = UberTrim(data=json)
rooftops = Geometry(utrim_7)
json_3 = JSON(Key=panel_6, Value=merge_6)
utrim_13 = UberTrim(data=sort_6.ValuesFloorPlate)
rooftops_2 = ClusterOutput(rooftops)
utrim_14 = UberTrim(data=utrim_12)
utrim_15 = UberTrim(data=utrim_10)
utrim_16 = UberTrim(data=json_3)
floorplate_properties = Data(utrim_14)
floorplates = Data(simplify(utrim_13))
utrim_17 = UberTrim(data=utrim_16)
facade_2 = Data(utrim_15)
facade_properties = Data(utrim_17)
facade_3 = ClusterOutput(facade_2)
floorplate_properties_2 = ClusterOutput(floorplate_properties)
floorplates_2 = ClusterOutput(floorplates)
facade_properties_2 = ClusterOutput(facade_properties)

# ==== cluster UberTrim: Better version of Trim
data = ClusterInput()
data_2 = Data(data)
trim = TrimTree(Tree=data_2, Depth=1)
null = NullItem(Item=trim)  # -> NullFlags, InvalidFlags, Description
bool = Boolean(invert(null.NullFlags))
trim_2 = TrimTree(Tree=data_2, Depth=bool)
data_3 = Data(trim_2)
data_4 = ClusterOutput(data_3)
