# Grasshopper definition ViewAnalysis.gh (Grasshopper 1.0.7)
# plug-ins: Human

input = DataInput(Destination="C:\Users\p-tmorgan\Documents\ViewAnalysis\Hackaton Multiple Mass.ghdata")  # -> flatten(Floorplate_Properties), Floorplates, Full_Mass, Facade, Rooftops
input_2 = DataInput(Destination="C:\Users\p-tmorgan\Documents\GitHub\Hackathon2018\Hackaton Multiple Mass.ghdata")  # -> Floorplate_Properties, Floorplates, Full_Mass, Full_Mass_Properties, Sub_Mass, Sub_Mass_Properties, Facade, Facade_Properties, Rooftops, Rooftop_Properties
dpipeline = DynamicGeometryPipeline(
    LayerFilter="Context",
    TypeFilter="All",
    NameFilter="*",
    GroupByLayer=False,
    GroupByType=False,
    IncludeHidden=True,
    IncludeLocked=True,
    enableFullPath=True,
    listenToAttributes=True)
dpipeline_2 = DynamicGeometryPipeline(
    LayerFilter="POI",
    TypeFilter="All",
    NameFilter="*",
    GroupByLayer=False,
    GroupByType=False,
    IncludeHidden=True,
    IncludeLocked=True,
    enableFullPath=True,
    listenToAttributes=True)
geo = Geometry(input_2.Rooftop_Properties)
data = Data(input_2.Facade)
viewanalysis = ViewAnalysis(data=input_2.Floorplate_Properties, brep=data, B=Slider(4, range=1..10), mesh_3=dpipeline, mesh_4=dpipeline_2)  # -> J, T
O = Data(viewanalysis.J)
pt = Point(<point referenced from the Rhino model>)
viewanalysislegend = ViewAnalysisLegend(O=O, pt=pt)  # -> legendmesh, legendtextsrf, legendbasept, textvaluesbasepts, legendtextvalues
J = Data(viewanalysis.J)
T = Data(viewanalysis.T)
data_2 = Data(viewanalysislegend.legendmesh)
data_3 = Data(viewanalysislegend.legendtextsrf)
data_4 = Data(viewanalysislegend.legendbasept)
data_5 = Data(viewanalysislegend.textvaluesbasepts)
data_6 = Data(viewanalysislegend.legendtextvalues)
output = DataOutput(
    Floorplate_Properties=input_2.Floorplate_Properties,
    Floorplates=input_2.Floorplates,
    Full_Mass=input_2.Full_Mass,
    Facade=input_2.Facade,
    Facade_Properties=J,
    Rooftops=input_2.Rooftops,
    Analysis_Mesh=T,
    ViewAnalysisLegendMesh=data_2,
    ViewAnalysisLegendTextSrf=data_3,
    Destination="C:\Users\p-tmorgan\Documents\GitHub\Hackathon2018\ViewAnalysis\Hackathon View Analysis.ghdata")  # disabled

# ==== cluster ViewAnalysis
brep = ClusterInput()
brep_2 = Brep(flatten(brep))
edges = BrepEdges(Brep=brep_2)  # -> Naked, Interior, NonManifold
join = JoinCurves(Curves=edges.Naked, Preserve=False)
clockcrv = ClockwiseCurve(crv=join)
disc = Discontinuity(Curve=clockcrv, Level=1)  # -> Points, Parameters
lng = ListLength(List=disc.Points)
int = Integer(lng)
larger = LargerThan(FirstNumber=int, SecondNumber="0")  # -> LargerThan, OrEqualTo
shift = ShiftPaths(Data=larger.LargerThan, Offset=-1)
dispatch = Dispatch(List=clockcrv, DispatchPattern=shift)  # -> ListA, ListB
crv = Curve(dispatch.ListA)
item = ListItem(List=crv, Index=0, Wrap=True)  # -> Item, Item1
eval = EvaluateCurve(Curve=reparameterize(crv), Parameter="0.5")  # -> Point, Tangent, Angle
crv_2 = Curve(dispatch.ListB)
explode = Explode(Curve=item.Item, Recursive=True)  # -> Segments, Vertices
explode_2 = Explode(Curve=item.Item1, Recursive=True)  # -> Segments, Vertices
pdecon = Deconstruct(Point=eval.Point)  # -> XComponent, YComponent, ZComponent
eval_2 = EvaluateLength(Curve=explode.Segments, Length=0.5, Normalized=True)  # -> Point, Tangent, Parameter
eval_3 = EvaluateLength(Curve=explode_2.Segments, Length=0.5, Normalized=True)  # -> Point, Tangent, Parameter
sort = SortList(Keys=pdecon.ZComponent, ValuesA=crv)  # -> Keys, ValuesA
cp = ClosestPoint(Point=eval_2.Point, Cloud=eval_3.Point)  # -> ClosestPoint, CPIndex, Distance
item_2 = ListItem(List=explode_2.Segments, Index=cp.CPIndex, Wrap=True)
crv_3 = Curve(explode.Segments)
B = ClusterInput()
graft = GraftTree(Tree=item_2, IncludeEmptyLists=True, IncludeNullItems=True)
graft_2 = GraftTree(Tree=crv_3, IncludeEmptyLists=True, IncludeNullItems=True)
merge = Merge(Data1=graft_2, Data2=graft)
len = Length(Curve=merge)
division = Division(A=len, B=B)
avr = Average(Input=division)
int_2 = Integer(avr)
series = Series(Start=0, Step=1, Count=expr("x+1", int_2))
divide = DivideCurve(Curve=merge, Count=int_2, Kinks=False, UseTasks=True)  # -> simplify(Points), Tangents, Parameters
shift_2 = ShiftList(List=series, Shift=1, Wrap=False)  # -> simplify(List)
shift_3 = ShiftList(List=series, Shift=-1, Wrap=False)  # -> simplify(List)
expression = Expression(x=shift_2, y=int_2, Expression="x+y+1")
expression_2 = Expression(x=shift_3, y=int_2, Expression="x+y+1")
shift_4 = ShiftPaths(Data=divide.Points, Offset=-1)  # -> simplify(Data)
quad = MeshQuad(CornerA=shift_3, CornerB=shift_2, CornerC=expression, CornerD=expression_2)  # -> simplify(Face)
item_3 = ListItem(List=sort.ValuesA, Index=0, Wrap=True)
conmesh = ConstructMesh(Vertices=shift_4, Faces=quad)
trim = TrimTree(Tree=conmesh, Depth=1)
area = MeshArea(Mesh=trim)  # -> Area, Centroid
meshcp = MeshClosestPoint(Point=area.Centroid, Mesh=trim)  # -> Point, Index, Parameter
meval = MeshEval(Mesh=trim, Parameter=meshcp.Parameter)  # -> Point, Normal, Colour
line = LineSDL(Start=meshcp.Point, Direction=meval.Normal, Length=Slider(200, range=0..1000))
end = EndPoints(Curve=line)  # -> Start, End
area_2 = Area(Geometry=item_3)  # -> Area, Centroid
pt = Point(end.End)
dist = Distance(PointA=pt, PointB=area_2.Centroid)
expression_3 = Expression(x=dist, y=Slider(200, range=0..1000), Expression="x<y")
dispatch_2 = Dispatch(List=trim, DispatchPattern=expression_3)  # -> ListA, ListB
demesh = DeconstructMesh(Mesh=dispatch_2.ListB)  # -> Vertices, Faces, Colours, Normals
deface = DeconstructFace(Face=demesh.Faces)  # -> CornerA, CornerB, CornerC, CornerD
quad_2 = MeshQuad(CornerA=deface.CornerD, CornerB=deface.CornerC, CornerC=deface.CornerB, CornerD=deface.CornerA)
conmesh_2 = ConstructMesh(Vertices=demesh.Vertices, Faces=quad_2)
trim_2 = TrimTree(Tree=conmesh_2, Depth=1)
weave = Weave(Pattern=expression_3, Stream0=trim_2, Stream1=dispatch_2.ListA, NullGaps=False)
data = ClusterInput()
W = Data(weave)
data_2 = Data(flatten(data))
mesh = Data(W)
mesh_2 = Mesh(mesh)
explode_3 = MeshExplode(Mesh=mesh_2, Interpolate=False)
facen = FaceNormals(Mesh=explode_3)  # -> Centers, Normals
subtraction = Subtraction(A=Slider(135, range=0..1000), B=Slider(0, range=0..10))
dom = ConstructDomain(DomainStart=Slider(45, range=0..100), DomainEnd=subtraction)
range = Range(Domain=dom, Steps=10)
rad = Radians(Degrees=range)
Z = UnitZ(Factor=1)
xprod = CrossProduct(VectorA=Z, VectorB=facen.Normals, Unitize=False)  # -> Vector, Length
vrot = Rotate(Vector=graft(xprod.Vector), Axis=Z, Angle=rad)  # -> simplify(Vector)
mesh_3 = ClusterInput()
mesh_4 = ClusterInput()
mesh_5 = Mesh(mesh_3)
mesh_6 = Mesh(mesh_4)
mjoin = MeshJoin(Meshes=mesh_5)
mjoin_2 = MeshJoin(Meshes=mesh_6)
clean = CombineClean(Meshes=flatten(mesh_2))
merge_2 = Merge(Data1=clean, Data2=mjoin)
meshray = MeshRay(Mesh=merge_2, Point=graft(facen.Centers), Direction=vrot)  # -> Point, Hit
meshray_2 = MeshRay(Mesh=mjoin_2, Point=graft(facen.Centers), Direction=vrot)  # -> Point, Hit
lng_2 = ListLength(List=rad)
ma = MassAddition(Input=simplify(meshray.Hit))  # -> Result, PartialResults
ma_2 = MassAddition(Input=simplify(meshray_2.Hit))  # -> Result, PartialResults
multiplication = Multiplication(A=ma_2.Result, B=Slider(0.18, range=0..10))
subtraction_2 = Subtraction(A=lng_2, B=ma.Result)
max = Maximum(A=multiplication, B=Slider(1, range=0..1))
multiplication_2 = Multiplication(A=subtraction_2, B=max)
bnd = Bounds(Numbers=flatten(multiplication_2))
dedomain = DeconstructDomain(Domain=bnd)  # -> Start, End
remap = RemapNumbers(Value=multiplication_2, Source=bnd, Target=Domain(0, 1))  # -> Mapped, Clipped
gradient = Gradient(
    LowerLimit=0,
    UpperLimit=dedomain.End,
    Parameter=multiplication_2,
    stops=[0: RGB(234, 38, 0), 0.25: RGB(234, 126, 0), 0.5: RGB(254, 244, 84), 0.75: RGB(173, 203, 249), 1: RGB(75, 107, 169)])
trim_3 = TrimTree(Tree=remap.Mapped, Depth=2)
mcol = MeshColours(Mesh=simplify(graft(explode_3)), Colours=gradient)
preview = CustomPreview(Geometry=simplify(graft(explode_3)), Material=gradient)
python = GhPythonScript(x=data_2)  # -> out, a
# ---------- python: Python ----------
__author__ = "p-tmorgan"
__version__ = "2018.10.25"

import rhinoscriptsyntax as rs
import json

a = json.loads(x)
# ---------- end python ----------
dup = DuplicateDataMatch(SourceDataTree=python.a, SecondaryData1="AverageView")  # -> SourceData, SecondaryData1
lng_3 = ListLength(List=python.a)  # -> flatten(Length)
read = ReadJSON(Object=data_2, Key=flatten(python.a))
avr_2 = Average(Input=trim_3)  # -> flatten(ArithmeticMean)
item_4 = ListItem(List=dup.SecondaryData1, Index=0, Wrap=True)
merge_3 = Merge(Data1=python.a, Data2=item_4)
partition = PartitionList(List=read, Size=lng_3)
merge_4 = Merge(Data1=simplify(partition), Data2=simplify(graft(avr_2)))
json = JSON(Key=merge_3, Value=merge_4)  # -> flatten(JSON)
trim_4 = TrimTree(Tree=mcol, Depth=2)
T = ClusterOutput(trim_4)
J = ClusterOutput(json)

# ==== cluster ViewAnalysisLegend
series = Series(Start=0, Step=1, Count=10)
pt = ClusterInput()
multiplication = Multiplication(A=series, B=10)
O = ClusterInput()
pt_2 = Point(pt)
gradient = Gradient(
    LowerLimit=0,
    UpperLimit="100",
    Parameter=multiplication,
    stops=[0: RGB(234, 38, 0), 0.25: RGB(234, 126, 0), 0.5: RGB(254, 244, 84), 0.75: RGB(173, 203, 249), 1: RGB(75, 107, 169)])
read = ReadJSON(Object=O, Key="AverageView")
multiplication_2 = Multiplication(A=read, B=Slider(100, range=0..100))
legendpar = Ladybug_LegendParameters(customColors=flatten(gradient))  # -> legendPar; plug-in component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
ladybug = Ladybug_Ladybug()  # -> Vviiiiiiiiiizzz; plug-in component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
createlegend = Ladybug_CreateLegend(
    valuesOrRange=multiplication_2,
    legendBasePt=pt_2,
    legendTitle="Views %",
    legendSize=Slider(30, range=0..100),
    legendPar=legendpar)  # -> legendMesh, legendTextSrf, legendBasePt, port, textValuesBasePts, legendTextValues, recommendedTextSize; plug-in component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
legendmesh = ClusterOutput(createlegend.legendMesh)
legendtextsrf = ClusterOutput(createlegend.legendTextSrf)
legendbasept = ClusterOutput(createlegend.legendBasePt)
textvaluesbasepts = ClusterOutput(createlegend.textValuesBasePts)
legendtextvalues = ClusterOutput(createlegend.legendTextValues)

# ==== cluster ClockwiseCurve: Reorders controlpoints of curve to clockwise
crv = ClusterInput()
crv_2 = Curve(crv)
cp = ControlPoints(Curve=crv_2)  # -> simplify(Points), Weights, Knots
shift = ShiftList(List=cp.Points, Shift=1, Wrap=True)
pdecon = Deconstruct(Point=cp.Points)  # -> XComponent, YComponent, ZComponent
pdecon_2 = Deconstruct(Point=shift)  # -> XComponent, YComponent, ZComponent
expression = Expression(x=pdecon.XComponent, y=pdecon_2.XComponent, z=pdecon.YComponent, u=pdecon_2.YComponent, Expression="(y-x)*(u+z)")
ma = MassAddition(Input=expression)  # -> Result, PartialResults
larger = LargerThan(FirstNumber=ma.Result, SecondNumber=0)  # -> simplify(LargerThan), OrEqualTo
dispatch = Dispatch(List=simplify(graft(crv_2)), DispatchPattern=larger.LargerThan)  # -> ListA, ListB
flip = FlipCurve(Curve=dispatch.ListB)  # -> Curve, Flag
merge = Merge(Data1=dispatch.ListA, Data2=flip.Curve)  # -> simplify(flatten(Result))
unflatten = UnflattenTree(Tree=merge, Guide=crv_2)
crv_3 = Curve(unflatten)
crv_4 = ClusterOutput(crv_3)
